vi "Main.gviweb"   [LabVIEW NXG 3.1.0]
panel controls:
  "System": i32
  "File": string = "/home/lvuser/README_File_Paths.txt"
  "Read File": bool
panel indicators:
  "System Status": string
  "File Contents": string
  "jid": string
  "state": string
uses:
  NI::Skyline::Configuration::Open Configuration.gvi
  WebApp::Filter Systems by Package.gviweb
  WebApp::Get System Info.gviweb
  WebApp::Read File.gviweb
  WebApp::Get Results.gviweb
diagram:
  w1 = ""  # Server
  call "Open Configuration.gvi"(server url=w1, username="", password="") -> (configuration=w2, error out=w3)
  call "Filter Systems by Package.gviweb"(configuration in=w2, package="crio-test-cell", error in=w3) -> (configuration out=w4, systems=w5, error out=w6)
  for {
    w7 = each element of w5
    Property Node(instance in=w7) -> ("alias"=w9)
    append w9 to w8
  }
  Property Node(instance in=reference to "System", "Items"=w8, "Value"=0, error in=w6) -> (error out=w10)
  while {
    Property Node(instance in=reference to "System", error in=w10) -> ("Items"=w11)
    Array Index(array=w11) -> (out0[$System]=w12)
    call "Get System Info.gviweb"(configuration in=w4, System=w12) -> (State=w13, configuration out=w14, ID=w15)
    event (timeout = 500) {
      on Timeout {
        case (w13) {
          frame "Disconnected", Default { }
          frame "Connected" { }
        }
      }
      on "System" Value changed { }
      on "Read File" Value changed {
        call "Read File.gviweb"(configuration=w14, minion ID=w15, file=$File) -> (configuration out=w16, jid=w17)
        $jid <- w17
        call "Get Results.gviweb"(configuration=w16, jid=w17) -> (state=w18, file contents=w19)
        $state <- w18
        $"File Contents" <- w19
      }
    }
    $"System Status" <- w13
    stop if FALSE
  }
